# Grasshopper definition ShapeFromDeformationShell.gh (Grasshopper 1.0.7)
# plug-ins: Human, Karamba3D, Kangaroo2 Components

# ---- group: Create Geometry - Variation 1
pt = Point([Point(3396.3329, 132.55142, 0), Point(201.70456, 1076.80971, 0), Point(1017.07072, 3764.76561, 0), Point(3381.88153, 4853.523882, 0), Point(5994.112194, 3282.57045, 0), Point(7336.08143, 2395.5387, 0), Point(6206.92081, 960.83685, 0), Point(4649.2776, 1427.150309, 0)])
voronoi = Voronoi(Points=pt, BruteForceOverride=False)
endwidth = Slider(166, range=0..300)
t = Slider(0.53, range=0.5..1)
circlefactor = Slider(0.47, range=0.3..0.85)
pline = PolyLine(Vertices=pt, Closed=True)
xy = XYPlane(Origin=Point(0, 0, 0))
item = ListItem(List=pt, Index=0, Wrap=True)  # -> Item1, Item, Item1_2, Item2
trim = TrimWithRegion(Curve=voronoi, Region=pline, Plane=xy)  # -> Inside, Outside
# 04 - Large Deformation of a Shell（Modified by natsume）
# Difficulty: Hard
# Using the Large Deformation Analysis we can simulate the behaviour of a hanging model to find the optimum form for the applied stresses. The principle stress lines of the shell can be view after the analysis.
# For viewing in the FREE Version use a Analyze Model component instead of the Optimize Cross Section component. For viewing in the Trial Version set the Mesh Resolution of the Mesh Breps component to 10.
end = EndPoints(Curve=trim.Inside)  # -> Start, End
eval = EvaluateCurve(Curve=reparameterize(trim.Inside), Parameter=circlefactor)  # -> Point, Tangent, Angle
avr = Average(Input=[end.Start, end.End])
ln = Line(StartPoint=end.Start, EndPoint=end.End)
ln_2 = Line(StartPoint=avr, EndPoint=eval.Point)
eval_2 = EvaluateLength(Curve=ln, Length=endwidth, Normalized=False)  # -> Point, Tangent, Parameter
eval_3 = EvaluateCurve(Curve=ln, Parameter=eval_2.Parameter)  # -> flatten(Point), Tangent, Angle
eval_4 = EvaluateCurve(Curve=ln, Parameter=expr("1-x", eval_2.Parameter))  # -> flatten(Point), Tangent, Angle
eval_5 = EvaluateCurve(Curve=ln_2, Parameter=t)  # -> flatten(Point), Tangent, Angle
circle = Circle3Pt(PointA=eval_3.Point, PointB=eval_4.Point, PointC=eval_5.Point)  # -> Circle, Plane, Radius
xy_2 = XYPlane(Origin=Point(0, 0, 0))
trim_2 = TrimWithRegion(Curve=circle.Circle, Region=pline, Plane=xy_2)  # -> flatten(Inside), Outside
end_2 = EndPoints(Curve=trim_2.Inside)  # -> Start, End
shift = ShiftList(List=end_2.End, Shift=1, Wrap=True)
crv = Curve(trim_2.Inside)
ln_3 = Line(StartPoint=end_2.Start, EndPoint=shift)

# ---- group: Toggle between Variations & Mesh Geometry
merge = Merge(Data1=crv, Data2=ln_3)  # -> flatten(Result)
boundary = BoundarySurfaces(Edges=merge)
mesh_breps = MeshBrepsKaramba3D(
    Brep=boundary,
    MeshResolution=Slider(100, range=0..1000),
    EdgeRefinementFactor=0.67,
    PointReduction=False,
    SmoothingStepSize=Slider(1, range=0..1),
    SmoothingIterations=5)  # -> Mesh, Info

# ---- group: Define Loads
formload = Slider(18, range=10..40)
Z = UnitZ(Factor=formload)
loads = LoadsKaramba3D(Vector=Z, LCase="0", mode="Gravity")

# ---- group: Define Cross Sections
matselect = MaterialSelectionKaramba3D(menu=[dropdown(7), dropdown(5)])
cross_section = CrossSectionKaramba3D(FamilyNameOfCrossSection="DefaultCroSec", Material=matselect, Height_mm=Slider(150, range=0..300), mode="Shell - Const")

# ---- group: Define Elements
meshtoshell = MeshToShellKaramba3D(Mesh=mesh_breps.Mesh, CrossSection=cross_section, LimitDistance_mm=0.005)  # -> Element, Points, Info

# ---- group: Define Supports
pt_2 = Point(meshtoshell.Points)
pull = PullPoint(Point=pt_2, Geometry=ln_3, ClosestOnly=True)  # -> ClosestPoint, Distance
smaller = SmallerThan(FirstNumber=pull.Distance, SecondNumber="0.01")  # -> SmallerThan, OrEqualTo
cull = CullPattern(List=pt_2, CullPattern=smaller.SmallerThan)
supp = SupportKaramba3D(PosInd=cull, menu=[buttons(on, on, on, off, off, off)])

# ---- group: Assemble Model
assemble = AssembleModelKaramba3D(Elem=meshtoshell.Element, Support=supp, Load=loads, LimitDistance_mm=Slider(1e-06, range=0..1e-06))  # -> Model, Info, Mass_kg, CenterOfGravity, LoadCaseNames

# ---- group: 主応力の計算
analyze = AnalyzeKaramba3D(Model=assemble.Model)  # -> CalculatedModel, MaximumDisplacement_mm, ResultingForceOfGravity_N, ElasticEnergyChange_kNm
modelview = ModelViewKaramba3D(Model=analyze.CalculatedModel, ResultFactors=1, ResultCase=-1)  # -> Model, DeformedMesh, DeformedAxes, DeformedModel
shellview = ShellViewKaramba3D(Model=modelview.Model, IndexOfLayer=0)  # -> Model, MeshesOfRenderedShells, LegendColors, LegendTags
medges = MeshEdges(Mesh=modelview.DeformedMesh)  # -> NakedEdges, InteriorEdges, NonManifoldEdges
legend = Legend(Colour=shellview.LegendColors, Tags=shellview.LegendTags, LegendType=101)
popgeo = PopulateGeometry(Geometry=modelview.DeformedMesh, Count=Slider(50, range=30..50), Seed=1)
shelllineresults = LineResultsOnShellsKaramba3D(
    AnalyzedModel=modelview.Model,
    LayerPosition=Slider(1, range=-1..1),
    ListOfSourcesOfPrincipalStressLinesLinesPoints=flatten(popgeo),
    SegmentLength_m=Slider(1000, range=0..1000),
    DA_deg=5,
    mode="PrincStress")  # -> AnalyzedModel, Lines1, Lines2

# ---- group: 梁の解析
number_slider = Slider(50, range=0..100)
line = Line(medges.NakedEdges)
lines1 = Line(shelllineresults.Lines1)
lines2 = Line(shelllineresults.Lines2)
flatten = FlattenTree(Tree=[line, lines1, lines2], Path="{0}")
cross_section_2 = CrossSectionKaramba3D(
    FamilyNameOfCrossSection="DefaultCroSec",
    Material=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,
    Height_mm=number_slider,
    UpperFlangeWidth_mm=number_slider,
    LowerFlangeWidth_mm=number_slider,
    mode="Trapezoid")
llinter = LineLineIntersectionKaramba3D(Line=flatten, LimitDistance_m=0.005)  # -> IntersectionPoints, LineSubSegements
linetobeam = LineToBeamKaramba3D(
    Line=flatten(llinter.LineSubSegements),
    CrossSection=cross_section_2,
    New=True,
    Remove=True,
    LimitDistance_mm=0.005,
    Bending=True,
    SetBucklingLength=True,
    ToPolylineMaxAngle=0.03,
    ToPolylineTolerance=0.01,
    ToPolylineMinEdgeLength=0.25)  # -> Element, Points, Info
pdecon = Deconstruct(Point=linetobeam.Points)  # -> XComponent, YComponent, ZComponent
smaller_2 = SmallerThan(FirstNumber=pdecon.ZComponent, SecondNumber=Slider(0, range=0..10))  # -> SmallerThan, OrEqualTo
Z_2 = UnitZ(Factor=1)
cull_2 = CullPattern(List=linetobeam.Points, CullPattern=smaller_2.OrEqualTo)
neg = Negative(Value=Z_2)
supp_2 = SupportKaramba3D(PosInd=cull_2, menu=[buttons(on, on, on, off, off, off)])
loads_2 = LoadsKaramba3D(Vector=neg, LCase="0", mode="Gravity")
assemble_2 = AssembleModelKaramba3D(Elem=linetobeam.Element, Support=supp_2, Load=loads_2, LimitDistance_mm=Slider(1e-05, range=0..1e-05))  # -> Model, Info, Mass_kg, CenterOfGravity, LoadCaseNames
analyze_2 = AnalyzeKaramba3D(Model=assemble_2.Model)  # -> CalculatedModel, MaximumDisplacement_mm, ResultingForceOfGravity_N, ElasticEnergyChange_kNm
modelview_2 = ModelViewKaramba3D(Model=analyze_2.CalculatedModel, ResultFactors=1, ResultCase=-1)  # -> Model, DeformedMesh, DeformedAxes, DeformedModel
join = JoinCurves(Curves=flatten, Preserve=False)
mp = MultiPipe(Curves=join, NodeSize=Slider(21, range=0..30), EndOffset=1, StrutSize=1, Segment=0, KinkAngle=0.6, CubeFit=0, Caps=0)
beamview = BeamViewKaramba3D(Model=modelview_2.Model)  # -> Model, MeshesOfRenderedBeams, DeformedBeamAxes, LegendColors, LegendTags

# ----
previewlw = CustomPreviewLineweights(Geometry=<missing>, Shader=<missing>, Thickness=<missing>)
