# Grasshopper definition building.gh (Grasshopper 1.0.7)
# plug-ins: Kangaroo2 Components, Karamba3D

number_slider = Slider(4000, range=0..4000)
number_slider_2 = Slider(3600, range=0..4000)
number_slider_3 = Slider(1, range=0..10)
number_slider_4 = Slider(10800, range=0..11000)
number_slider_5 = Slider(6, range=0..10)
pt = ConstructPoint(XCoordinate=0, YCoordinate=number_slider_4, ZCoordinate=0)
xy = XYPlane(Origin=pt)
recgrid = Rectangular(Plane=xy, SizeX=number_slider_2, SizeY=Slider(3600, range=0..4000), ExtentX=number_slider_5, ExtentY=number_slider_3)  # -> Cells, Points
recgrid_2 = Rectangular(Plane=PlaneXY(0, 0, 0), SizeX=number_slider_2, SizeY=number_slider_4, ExtentX=number_slider_5, ExtentY=number_slider_3)  # -> Cells, Points
number_slider_6 = Slider(6, range=0..10)
explode = Explode(Curve=flatten([recgrid_2.Cells, recgrid.Cells]), Recursive=True)  # -> flatten(Segments), flatten(Vertices)
# Create base model to input karamba
boundary = BoundarySurfaces(Edges=flatten([recgrid.Cells, recgrid_2.Cells]))
duppt = RemoveDuplicatePts(Points=explode.Vertices, Tolerance=0.01)
dupln = RemoveDuplicateLines(Lines=explode.Segments, Tolerance=0.01)
Z = UnitZ(Factor=number_slider)
line = LineSDL(Start=duppt, Direction=Z, Length=number_slider)
arrlinear = LinearArray(Geometry=boundary, Direction=Z, Count=number_slider_6)  # -> Geometry, Transform
arrlinear_2 = LinearArray(Geometry=line, Direction=Z, Count=expr("x-1", number_slider_6))  # -> Geometry, Transform
arrlinear_3 = LinearArray(Geometry=dupln, Direction=Z, Count=number_slider_6)  # -> Geometry, Transform
flip = FlipMatrix(Data=arrlinear.Geometry)
branch = TreeBranch(Tree=arrlinear_2.Geometry, Path=["{0;0;4}", "{0;0;17}"], MaintainPaths=True)
branch_2 = TreeBranch(Tree=arrlinear_2.Geometry, Path=["{0;0;2}", "{0;0;16}"], MaintainPaths=True)
flip_2 = FlipMatrix(Data=arrlinear_3.Geometry)
end = EndPoints(Curve=branch_2)  # -> Start, End
end_2 = EndPoints(Curve=branch)  # -> Start, End
bang = ExplodeTree(Data=flip_2)  # -> Branch0, Branch1, Branch2, Branch3, Branch4, Branch5
bang_2 = ExplodeTree(Data=flip)  # -> Branch0, Branch1, Branch2, Branch3, Branch4, Branch5
ln = Line(StartPoint=end.Start, EndPoint=end_2.End)

# ---- group: Slab
srf = Surface(flatten([bang_2.Branch1, bang_2.Branch2, bang_2.Branch3, bang_2.Branch4, bang_2.Branch5]))

# ---- group: Girder
line_2 = Line(flatten([bang.Branch1, bang.Branch2, bang.Branch3, bang.Branch4, bang.Branch5]))

# ---- group: Column
line_3 = Line(flatten(arrlinear_2.Geometry))

# ---- group: Brace
line_4 = Line(flatten(ln))

# ---- group: FSlab
srf_2 = Surface(bang_2.Branch0)

# ---- group: FGirder
line_5 = Line(bang.Branch0)

# ---- group: Brace CrossSection
number_slider_7 = Slider(300, range=0..300)
number_slider_8 = Slider(15, range=0..15)
matselect = MaterialSelectionKaramba3D(Color=ColourSwatch(SwatchColor=RGB(39, 168, 0)), menu=[dropdown(1), dropdown(2)])
cross_section = CrossSectionKaramba3D(
    FamilyNameOfCrossSection="H",
    NameOfCrossSection="H-300x300x10x15",
    Material=matselect,
    Height_mm=number_slider_7,
    UpperFlangeWidth_mm=number_slider_7,
    LowerFlangeWidth_mm=number_slider_7,
    UpperFlangeThickness_mm=number_slider_8,
    LowerFlangeThickness_mm=number_slider_8,
    WebThickness_mm=Slider(10, range=0..10),
    mode="I")

# ---- group: Girder CrossSection
number_slider_9 = Slider(28, range=0..28)
number_slider_10 = Slider(350, range=0..350)
matselect_2 = MaterialSelectionKaramba3D(Color=ColourSwatch(SwatchColor=RGB(255, 48, 48)), menu=[dropdown(1), dropdown(2)])
cross_section_2 = CrossSectionKaramba3D(
    FamilyNameOfCrossSection="SH",
    NameOfCrossSection="H-700x350x16x28",
    Material=matselect_2,
    Height_mm=Slider(700, range=0..700),
    UpperFlangeWidth_mm=number_slider_10,
    LowerFlangeWidth_mm=number_slider_10,
    UpperFlangeThickness_mm=number_slider_9,
    LowerFlangeThickness_mm=number_slider_9,
    WebThickness_mm=Slider(16, range=0..16),
    FilletRadius_mm=Slider(8, range=0..10),
    mode="I")

# ---- group: Column CrossSection
number_slider_11 = Slider(500, range=0..1000)
number_slider_12 = Slider(25, range=0..50)
matselect_3 = MaterialSelectionKaramba3D(Color=ColourSwatch(SwatchColor=RGB(48, 169, 255)), menu=[dropdown(1), dropdown(2)])
multiplication = Multiplication(A=number_slider_12, B=3.5)
cross_section_3 = CrossSectionKaramba3D(
    FamilyNameOfCrossSection="BCP",
    NameOfCrossSection="BOX-500x25",
    Material=matselect_3,
    Height_mm=number_slider_11,
    UpperFlangeWidth_mm=number_slider_11,
    LowerFlangeWidth_mm=number_slider_11,
    UpperFlangeThickness_mm=number_slider_12,
    LowerFlangeThickness_mm=number_slider_12,
    SidewallsThickness_mm=number_slider_12,
    FilletRadius_mm=multiplication,
    mode="Box")

# ---- group: 300+150
number_slider_13 = Slider(450, range=0..450)

# ----
# Slab thickness Settings
matselect_4 = MaterialSelectionKaramba3D(menu=[dropdown(7), dropdown(5)])
cross_section_4 = CrossSectionKaramba3D(
    FamilyNameOfCrossSection="DefaultCroSec",
    Material=matselect_4,
    Height_mm=Slider(150, range=0..150),
    mode="Shell - Const")
cross_section_5 = CrossSectionKaramba3D(FamilyNameOfCrossSection="DefaultCroSec", Material=matselect_4, Height_mm=number_slider_13, mode="Shell - Const")
entwine = Entwine(Branch00=cross_section_5, Branch01=cross_section_4, FlattenInputs=True)

# ---- group: FGirder CrossSection
number_slider_14 = Slider(600, range=0..600)
matselect_5 = MaterialSelectionKaramba3D(Color=ColourSwatch(SwatchColor=RGB(138, 138, 138)), menu=[dropdown(7), dropdown(4)])
cross_section_6 = CrossSectionKaramba3D(
    FamilyNameOfCrossSection="DefaultCroSec",
    NameOfCrossSection="BD-600x1800",
    Material=matselect_5,
    Height_mm=Slider(1600, range=0..2000),
    UpperFlangeWidth_mm=number_slider_14,
    LowerFlangeWidth_mm=number_slider_14,
    mode="Trapezoid")

# ----
entwine_2 = Entwine(Branch00=cross_section_6, Branch01=cross_section_3, Branch02=cross_section_2, Branch03=cross_section, FlattenInputs=True)
entwine_3 = Entwine(Branch00=srf_2, Branch01=srf, FlattenInputs=True)
entwine_4 = Entwine(Branch00=line_5, Branch01=line_3, Branch02=line_2, Branch03=line_4, FlattenInputs=True)

# ---- group: Office LL 1800N/m2
number_slider_15 = Slider(1.8, range=0..10)

# ---- group: DL 3000N/m2
number_slider_16 = Slider(3, range=0..10)

# ---- group: Office LL 800N/m2
number_slider_17 = Slider(1.8, range=0..10)

# ----
panel = Panel("""FGirder
Column
Girder
Brace""")
panel_2 = Panel("""true
true
true
false""")
graft = GraftTree(Tree=panel_2, IncludeEmptyLists=True, IncludeNullItems=True)
graft_2 = GraftTree(Tree=panel, IncludeEmptyLists=True, IncludeNullItems=True)
number_slider_18 = Slider(0.3, range=0..1)
addition = Addition(A=number_slider_17, B=number_slider_16)
addition_2 = Addition(A=number_slider_15, B=number_slider_16)
multiplication_2 = Multiplication(A=addition, B=number_slider_18)
mesh_breps = MeshBrepsKaramba3D(
    Brep=entwine_3,
    MeshResolution="1000",
    EdgeRefinementFactor=0.67,
    PointReduction=False,
    SmoothingStepSize=1,
    SmoothingIterations=5)  # -> flatten(Mesh), Info
Z_2 = UnitZ(Factor=1)
supp = SupportKaramba3D(PosInd=duppt, menu=[buttons(on, on, on, off, off, off)])
linetobeam = LineToBeamKaramba3D(
    Line=entwine_4,
    Identifier=graft_2,
    CrossSection=entwine_2,
    New=True,
    Remove=True,
    LimitDistance_mm=0.005,
    Bending=graft,
    SetBucklingLength=True,
    ToPolylineMaxAngle=0.03,
    ToPolylineTolerance=0.01,
    ToPolylineMinEdgeLength=0.25)  # -> flatten(Element), Points, Info
meshtoshell = MeshToShellKaramba3D(Mesh=entwine_3, CrossSection=entwine, LimitDistance_mm=0.005, Bending=[False, False])  # -> flatten(Element), Points, Info
Z_3 = UnitZ(Factor=addition_2)
Y = UnitY(Factor=number_slider_18)
X = UnitX(Factor=multiplication_2)
neg = Negative(Value=Z_2)
X_2 = UnitX(Factor=number_slider_18)
Y_2 = UnitY(Factor=multiplication_2)
neg_2 = Negative(Value=Z_3)
loads = LoadsKaramba3D(Vector=X, Mesh=mesh_breps.Mesh, LCase="EX", mode="MeshLoad -Const.", menu=[buttons(off, on, off), buttons(on, on)])
loads_2 = LoadsKaramba3D(Vector=Y_2, Mesh=mesh_breps.Mesh, LCase="EY", mode="MeshLoad -Const.", menu=[buttons(off, on, off), buttons(on, on)])
loads_3 = LoadsKaramba3D(Vector=X_2, LCase="EX", mode="Gravity")
loads_4 = LoadsKaramba3D(Vector=neg, LCase="DL+LL", mode="Gravity")
loads_5 = LoadsKaramba3D(Vector=Y, LCase="EY", mode="Gravity")
loads_6 = LoadsKaramba3D(
    Vector=neg_2,
    Mesh=mesh_breps.Mesh,
    LCase="DL+LL",
    mode="MeshLoad -Const.",
    menu=[buttons(off, on, off), buttons(on, on)])
load = LoadKaramba3D([loads_4, loads_6, loads_5, loads_3, loads_2, loads])
assemble = AssembleModelKaramba3D(Elem=[linetobeam.Element, meshtoshell.Element], Support=supp, Load=load, LimitDistance_mm=0.005)  # -> Model, Info, Mass_kg, CenterOfGravity, LoadCaseNames
analyze = AnalyzeKaramba3D(Model=assemble.Model)  # -> CalculatedModel, MaximumDisplacement_mm, ResultingForceOfGravity_N, ElasticEnergyChange_kNm
modelview = ModelViewKaramba3D(Model=analyze.CalculatedModel, ResultFactors=1, ResultCase=-1)  # -> Model, DeformedMesh, DeformedAxes, DeformedModel
shellview = ShellViewKaramba3D(Model=modelview.Model, IndexOfLayer=0)  # -> Model, MeshesOfRenderedShells, LegendColors, LegendTags
beamview = BeamViewKaramba3D(Model=modelview.Model)  # -> Model, MeshesOfRenderedBeams, DeformedBeamAxes, LegendColors, LegendTags
legend = Legend(Colour=beamview.LegendColors, Tags=beamview.LegendTags, LegendType=101)
