# Grasshopper definition simple-beam.gh (Grasshopper 1.0.7)
# plug-ins: Karamba3D

梁長_mm = Slider(1000, range=0..1000)
荷重位置 = Slider(0.618, range=0..1)
荷重_n = Slider(10, range=0..10)
X = UnitX(Factor=1)
pt = Point(Point(0, 0, 0))
multiplication = Multiplication(A=梁長_mm, B=荷重位置)
line = LineSDL(Start=pt, Direction=X, Length=梁長_mm)
end = EndPoints(Curve=line)  # -> Start, End
divlength = DivideLength(Curve=line, Length=multiplication)  # -> Points, Tangents, Parameters
item = ListItem(List=divlength.Points, Index=0, Wrap=True)  # -> Item, flatten(Item1)
merge = Merge(Data1=end.Start, Data2=item.Item1, Data3=end.End)
neg = Negative(Value=荷重_n)
pline = PolyLine(Vertices=flatten(merge), Closed=False)
Z = UnitZ(Factor=neg)
supp = SupportKaramba3D(PosInd=end.Start, menu=[buttons(on, on, on, on, off, off)])
supp_2 = SupportKaramba3D(PosInd=end.End, menu=[buttons(off, on, on, off, off, off)])
linetobeam = LineToBeamKaramba3D(
    Line=pline,
    New=True,
    Remove=True,
    LimitDistance_mm=0.005,
    Bending=True,
    SetBucklingLength=True,
    ToPolylineMaxAngle=0.03,
    ToPolylineTolerance=0.01,
    ToPolylineMinEdgeLength=0.25)  # -> Element, Points, Info
loads = LoadsKaramba3D(ForceVector=Z, Local=False, PosInd=item.Item1, LCase="0", mode="Point")
assemble = AssembleModelKaramba3D(Elem=linetobeam.Element, Support=[supp, supp_2], Load=loads, LimitDistance_mm=0.005)  # -> Model, Info, Mass_kg, CenterOfGravity, LoadCaseNames
analyze = AnalyzeKaramba3D(Model=assemble.Model)  # -> CalculatedModel, MaximumDisplacement_mm, ResultingForceOfGravity_N, ElasticEnergyChange_kNm
modelview = ModelViewKaramba3D(Model=analyze.CalculatedModel, ResultFactors=1, ResultCase=-1)  # -> Model, DeformedMesh, DeformedAxes, DeformedModel
beamview = BeamViewKaramba3D(Model=modelview.Model)  # -> Model, MeshesOfRenderedBeams, DeformedBeamAxes, LegendColors, LegendTags
